# Grasshopper definition PRC_Proto-bb.gh (Grasshopper 0.9.76)
# plug-ins: KUKA|prc - parametric robot control

# Rotate the curve in steps of N degrees
panel = Panel("5")
int = Integer(panel)
# Curve to use as input.
# Import CSV, then
# run CrvThroughPoints
crv = Curve(<curve referenced from the Rhino model>)
multiplication = Multiplication(A=Slider(0, range=0..12), B=int)
rad = Radians(Degrees=multiplication)
# Divide the curve into N parts:
number_slider = Slider(38, range=5..100)
custom_krl = KUKAPrcCustomKRL(TextAsKRL="PULSE($OUT[1],TRUE,0.1)")
rotate = Rotate(Geometry=crv, Angle=rad, Plane=PlaneXY(0, 0, 0))  # -> Geometry, Transform
divide = DivideCurve(Curve=rotate.Geometry, Count=number_slider, Kinks=False)  # -> Points, Tangents, Parameters
cmd_weave = CommandWeaver(Command2=custom_krl, enabletree=False)
xy = XYPlane(Origin=divide.Points)
pt = Point(Point(-1032.579048, 691.9405232, 0))
mesh = Mesh(<mesh referenced from the Rhino model>)

# ---- group: Orient so that they are aligned to the robot
orient_pln = KUKAPrcOrientPlane(Plane=xy, OrientPoint=pt)

# ----
yz = YZPlane(Origin=Point(0, 0, 0))
custom_tool = CustomToolForKUKAPrc(
    CustomToolGeometry=mesh,
    toolid=6,
    toolvala=0,
    toolvalb=0,
    toolvalc=0,
    toolvalx=0,
    toolvaly=0,
    toolvalz=0,
    valuesset=False)
custom_tool_via_pln = CustomToolPlane(ToolFrame=yz, ToolGeometry=mesh, ToolNumber=6)

# ---- group: Turn into LINear movement
lin_move = KUKAPrcLINearMovement(TargetAsPlane=orient_pln, extaxenabled=False, interpolation="C_DIS")

# ----
kr_6_10_r900 = KUKAAgilusKR6KR10R900(highresactive=False)

# ---- group: Set same base number in Settings, as calibrated at the robot
kuka_prc = KUKAPrcCORE(
    SimulationSlider=Slider(0.292, range=0..1),
    KUKAPrcCommands=lin_move,
    KUKAPrcTool=custom_tool_via_pln,
    KUKAPrcRobot=kr_6_10_r900,
    acc_cp=nan,
    acc_ptp=-1,
    basea=0,
    baseb=0,
    basec=0,
    baseindex=4,
    basex=450,
    basey=-200,
    basez=200,
    camrobformatting="""&ACCESS RVP
&REL 1
&PARAM TEMPLATE = C:\KRC\Roboter\Template\vorgabe
&PARAM EDITMASK = *
[PROJECTNAME]

[SPLITDEFS]

;FOLD INI
;FOLD BASISTECH INI
GLOBAL INTERRUPT DECL 3 WHEN $STOPMESS==TRUE DO IR_STOPM ( )
INTERRUPT ON 3
BAS (#INITMOV,0 )
;ENDFOLD (BASISTECH INI)
;ENDFOLD (INI)

[STARTAXPOS]

[SETPARAMETERS]

[COMMANDS]

END""",
    camrobon=False,
    checkallcolls=False,
    enda01=5,
    enda02=-90,
    enda03=100,
    enda04=5,
    enda05=10,
    enda06=-5,
    ende01=0,
    ende02=0,
    ende03=0,
    ende04=0,
    endindex=0,
    haltatend=False,
    hash=2711,
    initialstatus="110",
    int_advance=3,
    int_cdis=nan,
    int_cori=nan,
    int_cptp=-1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)  # -> RobotGeometry, AnalysisOutput
