# Grasshopper definition PRC_Proto-d-stable.gh (Grasshopper 0.9.76)
# plug-ins: KUKA|prc - parametric robot control

# Rotate the curve in steps of N degrees
panel = Panel("5")
# Curve to use as input.
# Import CSV, then
# run CrvThroughPoints
crv = Curve(<curve referenced from the Rhino model>)
set_digital = KUKAPrcSetDigitalOut(
    DigitalOut1=False,
    DigitalOut2=False,
    DigitalOut3=False,
    DigitalOut4=False,
    DigitalOut5=False,
    DigitalOut6=False,
    DigitalOut7=False,
    DigitalOut8=False,
    ContinuousMovement=False)
int = Integer(panel)
int_2 = Integer("5")
multiplication = Multiplication(A=Slider(-6, range=-6..6), B=int)
multiplication_2 = Multiplication(A=Slider(-16, range=-20..20), B=int_2)
crv_2 = Curve(<curve referenced from the Rhino model>)
rad = Radians(Degrees=multiplication)
rad_2 = Radians(Degrees=multiplication_2)
# Divide the curve into N parts:
number_slider = Slider(38, range=5..100)
custom_krl = KUKAPrcCustomKRL(TextAsKRL="PULSE($OUT[1],TRUE,0.1)")
rotax = RotateAxis(Geometry=crv, Angle=rad, Axis=crv_2)  # -> Geometry, Transform
pt = Point(Point(-1002.00974, 191.8256043, 0))
cmd_weave = CommandWeaver(enabletree=False)
orient_pln = KUKAPrcOrientPlane()
divide = DivideCurve(Curve=rotax.Geometry, Count=number_slider, Kinks=False)  # -> Points, Tangents, Parameters
line = Line(Line((0, 0, 0), (0, 0, 1215)))
vec2pt = Vector2Pt(PointA=divide.Points, PointB=pt, Unitize=False)  # -> Vector, Length
mesh = Mesh(<mesh referenced from the Rhino model>)
yz = YZPlane(Origin=Point(0, 0, 0))
rotax_2 = RotateAxis(Geometry=vec2pt.Vector, Angle=rad_2, Axis=line)  # -> Geometry, Transform
custom_tool = CustomToolForKUKAPrc(
    CustomToolGeometry=mesh,
    toolid=6,
    toolvala=0,
    toolvalb=-120,
    toolvalc=180,
    toolvalx=-300,
    toolvaly=0,
    toolvalz=300,
    valuesset=True)
custom_tool_via_pln = CustomToolPlane(ToolFrame=yz, ToolGeometry=mesh, ToolNumber=6)
vec = Vector(Vector(0, 0, 409))
kr_6_10_r1100 = KUKAAgilusKR6KR10R1100(highresactive=False)
pl = ConstructPlane(Origin=divide.Points, XAxis=vec, YAxis=rotax_2.Geometry)
kr_6_10_r900 = KUKAAgilusKR6KR10R900(highresactive=False)

# ---- group: Turn into LINear movement
lin_move = KUKAPrcLINearMovement(TargetAsPlane=pl, extaxenabled=False, interpolation="C_DIS")  # -> flatten(KUKAPrcCommand)

# ----
weave = Weave(Pattern=[0, 1], Stream0=graft(lin_move), Stream1=custom_krl, NullGaps=False)  # -> flatten(Weave)

# ---- group: Set same base number in Settings, as calibrated at the robot
kuka_prc = KUKAPrcCORE(
    SimulationSlider=Slider(1, range=0..1),
    KUKAPrcCommands=weave,
    KUKAPrcTool=custom_tool,
    KUKAPrcRobot=kr_6_10_r1100,
    acc_cp=nan,
    acc_ptp=-1,
    basea=0,
    baseb=0,
    basec=0,
    baseindex=4,
    basex=450,
    basey=-200,
    basez=200,
    camrobformatting="""&ACCESS RVP
&REL 1
&PARAM TEMPLATE = C:\KRC\Roboter\Template\vorgabe
&PARAM EDITMASK = *
[PROJECTNAME]

[SPLITDEFS]

;FOLD INI
;FOLD BASISTECH INI
GLOBAL INTERRUPT DECL 3 WHEN $STOPMESS==TRUE DO IR_STOPM ( )
INTERRUPT ON 3
BAS (#INITMOV,0 )
;ENDFOLD (BASISTECH INI)
;ENDFOLD (INI)

[STARTAXPOS]

[SETPARAMETERS]

[COMMANDS]

END""",
    camrobon=False,
    checkallcolls=False,
    enda01=5,
    enda02=-90,
    enda03=100,
    enda04=5,
    enda05=10,
    enda06=-5,
    ende01=0,
    ende02=0,
    ende03=0,
    ende04=0,
    endindex=0,
    haltatend=False,
    hash=5380,
    initialstatus="110",
    int_advance=3,
    int_cdis=nan,
    int_cori=nan,
    int_cptp=-1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)  # -> RobotGeometry, AnalysisOutput
