# Grasshopper definition PRC_Proto-e.gh (Grasshopper 0.9.76)
# plug-ins: KUKA|prc - parametric robot control

# Rotate the curve in steps of N degrees
panel = Panel("5")
# Curve to use as input.
# Import CSV, then
# run CrvThroughPoints
crv = Curve(<curve referenced from the Rhino model>)
int = Integer(panel)
multiplication = Multiplication(A=Slider(-6, range=-6..6), B=int)
crv_2 = Curve(<curve referenced from the Rhino model>)
rad = Radians(Degrees=multiplication)
# Divide the curve into N parts:
number_slider = Slider(50, range=5..100)
rotax = RotateAxis(Geometry=crv, Angle=rad, Axis=crv_2)  # -> Geometry, Transform
pt = Point(Point(-1002.00974, 191.8256043, 0))
orient_pln = KUKAPrcOrientPlane()
divide = DivideCurve(Curve=rotax.Geometry, Count=number_slider, Kinks=False)  # -> Points, Tangents, Parameters
line = Line(Line((0, 0, 0), (0, 0, 1215)))
vec2pt = Vector2Pt(PointA=divide.Points, PointB=pt, Unitize=False)  # -> Vector, Length
rotax_2 = RotateAxis(Geometry=vec2pt.Vector, Angle="-pi/2", Axis=line)  # -> Geometry, Transform
vec = Vector(Vector(0, 0, 409))
pl = ConstructPlane(Origin=divide.Points, XAxis=vec, YAxis=rotax_2.Geometry)
panel_2 = Panel("""PULSE($OUT[1],TRUE,0.1)
WAIT SEC 3.2""")

# ---- group: Turn into LINear movement
lin_move = KUKAPrcLINearMovement(TargetAsPlane=pl, extaxenabled=False, interpolation="C_DIS")  # -> flatten(KUKAPrcCommand)

# ----
yz = YZPlane(Origin=Point(0, 0, 0))
mesh = Mesh(<mesh referenced from the Rhino model>)
custom_krl = KUKAPrcCustomKRL(TextAsKRL=panel_2)
custom_tool = CustomToolForKUKAPrc(
    CustomToolGeometry=mesh,
    toolid=6,
    toolvala=0,
    toolvalb=-120,
    toolvalc=180,
    toolvalx=-300,
    toolvaly=0,
    toolvalz=300,
    valuesset=True)
custom_tool_via_pln = CustomToolPlane(ToolFrame=yz, ToolGeometry=mesh, ToolNumber=6)
weave = Weave(Pattern=[0, 1], Stream0=graft(lin_move), Stream1=custom_krl, NullGaps=False)  # -> flatten(Weave)
kr_6_10_r1100 = KUKAAgilusKR6KR10R1100(highresactive=False)

# ---- group: Set same base number in Settings, as calibrated at the robot
kuka_prc = KUKAPrcCORE(
    SimulationSlider=Slider(0.092, range=0..1),
    KUKAPrcCommands=weave,
    KUKAPrcTool=custom_tool,
    KUKAPrcRobot=kr_6_10_r1100,
    acc_cp=nan,
    acc_ptp=-1,
    basea=0,
    baseb=0,
    basec=0,
    baseindex=4,
    basex=450,
    basey=-200,
    basez=200,
    camrobformatting="""&ACCESS RVP
&REL 1
&PARAM TEMPLATE = C:\KRC\Roboter\Template\vorgabe
&PARAM EDITMASK = *
[PROJECTNAME]

[SPLITDEFS]

;FOLD INI
;FOLD BASISTECH INI
GLOBAL INTERRUPT DECL 3 WHEN $STOPMESS==TRUE DO IR_STOPM ( )
INTERRUPT ON 3
BAS (#INITMOV,0 )
;ENDFOLD (BASISTECH INI)
;ENDFOLD (INI)

[STARTAXPOS]

[SETPARAMETERS]

[COMMANDS]

END""",
    camrobon=False,
    checkallcolls=False,
    enda01=5,
    enda02=-90,
    enda03=100,
    enda04=5,
    enda05=10,
    enda06=-5,
    ende01=0,
    ende02=0,
    ende03=0,
    ende04=0,
    endindex=0,
    haltatend=False,
    hash=5380,
    initialstatus="110",
    int_advance=3,
    int_cdis=nan,
    int_cori=nan,
    int_cptp=-1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)  # -> RobotGeometry, AnalysisOutput
